# Grasshopper definition navmesh.ghx (Grasshopper 1.0.7)
# plug-ins: NGon

mesh = Mesh(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)
trianglesubdivision = TriangleSubdivision(Mesh=mesh, N="1")
mesh_edges = MeshEdges(Mesh=mesh)  # -> AllE, NakedE
start = Point(Point(-2257.811023, -21485.85235, 0))
end = Point(Point(10258.99427, 4673.240059, 0))
data = Data(mesh_edges.AllE)
getnakededges = GhPythonScript(mesh=mesh)  # -> out, a, b; inputs mesh: Mesh
# ---------- getnakededges: Python ----------
__author__ = "BobLYX"
__version__ = "2024.03.17"

import json
from Rhino.Geometry import Line, Point3d

def nakedEdges(mesh, lines = False):
    vertices = mesh["vertices"]
    faces = mesh["faces"]
    edge_counts = {}
    for f in faces:
        v1, v2, v3 = f
        edges = [(v1, v2), (v2, v3), (v3, v1)]
        for edge in edges:
            sorted_edge = tuple(sorted(edge))
            if sorted_edge in edge_counts:
                edge_counts[sorted_edge] += 1
            else:
                edge_counts[sorted_edge] = 1
    naked_edges = [edge for edge, count in edge_counts.items() if count == 1]
    if lines:
        ne = []
        for e in naked_edges:
            p1 = vertices[e[0]]
            p2 = vertices[e[1]]
            ne.append(Line(Point3d(p1[0], p1[1], 0), 
            Point3d(p2[0], p2[1], 0)))
            pass
        return ne
    return naked_edges

meshd = {"faces": [], "vertices": [] }
for f in mesh.Faces:
    meshd["faces"].append([f.A, f.B, f.C])

for v in mesh.Vertices:
    meshd["vertices"].append([
    v.X, v.Y
    ])

a = nakedEdges(meshd, True)
json_mesh = str(meshd).replace("'", "\"")
#json_mes
b = str(json_mesh)
#print(meshd["vertices"])
# ---------- end getnakededges ----------
data_2 = Data(mesh_edges.NakedE)
panel = Panel(start)
data_3 = Data([Line((6274.125, 5845.522461, 0), (12474.125, 14603.85645, 0)), Line((12474.125, 14603.85645, 0), (6274.125, 6595.522461, 0)), Line((6274.125, 6595.522461, 0), (6274.125, 5845.522461, 0)), Line((12474.125, 14603.85645, 0), (6274.125, 13853.85645, 0)), Line((6274.125, 13853.85645, 0), (6274.125, 6595.522461, 0)), Line((6274.125, 13853.85645, 0), (5674.125, 13853.85645, 0))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])
panel_2 = Panel(getnakededges.b)
ghpython_script = GhPythonScript(start=start, end=end, edges=data, mesh=mesh)  # -> out, a, b, c, d; inputs start: Point3d, end: Point3d, edges: list of Line, mesh: Mesh
# ---------- ghpython_script: Python ----------
__author__ = "BobLYX"
__version__ = "2024.03.16"

from Rhino.Geometry.Intersect import Intersection
from Rhino.Geometry import Point3d, Line, PointCloud
nodes = set()
xnodes = set()
xedges = []
naked_edges = mesh.GetNakedEdges()
nedges = []

for p in naked_edges:
    nedges.extend(p.GetSegments())

facelist = mesh.Faces
triangles = []
edgest = []
for i, f in enumerate(facelist):
    fv = facelist.GetFaceVertices(i)
    if fv[0] == False: continue
    a = fv[1]
    b = fv[2]
    c = fv[3]
    lines = [Line(a, b), Line(b,c), Line(c,a)]
    for l in lines:
        has_dup = False
        for e in edgest:
            if e.Equals(l): has_dup = True
            l.Flip()
            if e.Equals(l): has_dup = True
            l.Flip()
        if(not has_dup): edgest.append(l)
    triangles.append([[a.X, a.Y], [b.X, b.Y], [c.X, c.Y]])
    #print(fv)
#edges = edgest
d = edgest

for l in edges:
    source = l.From
    target = l.To
    nodes.add(source)
    nodes.add(target)
    pass

nodes = list(nodes)
for l in edges:
    source = l.From
    target = l.To
    sid = nodes.index(source)
    tid = nodes.index(target)
    xnodes.add(sid)
    xnodes.add(tid)
    #print("%d to %d" % (sid, tid))
    xedges.append({"source": sid, "target": tid})
    if l in nedges:
        #print("yee")
        pass

def getOther(node = 0, edge = {"source":0, "target": 1}):
    if node == edge["source"]:
        return edge["target"]
    return edge["source"]

def getNeighbors(id, xedges):
    neighbors = []
    for e in xedges:
        v = e.values()
        if not id in v: continue
        neighbors.append(getOther(id, e))
    return neighbors

def getEdges(id, xedges, to_line = False):
    edges = []
    for e in xedges:
        v = e.values()
        if not id in v: continue
        edges.append(e)
    return edges

def getNodes(edge, nodes):
    return [nodes[edge["source"]], nodes[edge["target"]]]
    pass

def edgeToLine(edge, nodes):
    return Line(nodes[edge["source"]], nodes[edge["target"]])
    pass

# Find the closest node
pc = PointCloud(nodes) 
cp1 = pc.ClosestPoint(start)
print(cp1)
n1 = getNeighbors(cp1, xedges)
cedges = []

def getTowardsTarget(node_ids, target, nodes):
    fnodes = [nodes[i] for i in node_ids]
    pc = PointCloud(fnodes)
    next_pt = fnodes[pc.ClosestPoint(target)]
    next_id = nodes.index(next_pt)
    return next_id

def triArea(t = []):
    area = abs(
    (t[0][0] * (t[1][1] - t[2][1])
    + t[1][0] * (t[2][1] - t[0][1])
    + t[2][0] * (t[0][1] - t[1][1]))
    /2.0
    )
    return area
    pass

def ptInsideTriangle(pt, t = [], tolerance = 5):
    area = triArea(t)
    area_p12 =triArea([pt, t[1], t[2]])
    area_p02 = triArea([pt, t[0], t[2]])
    area_p01 = triArea([pt, t[0], t[1]])
    #print(abs(area - (area_p12 + area_p02 + area_p01)))
    return (abs(area - (area_p12 + area_p02 + area_p01)) < tolerance)

#d = [Point3d(t[0], t[1], 0) for t in triangles[0]]
#print(ptInsideTriangle([test[0], test[1]], triangles[0]))

path = [cp1]
cnode = cp1
end_id = pc.ClosestPoint(end)

while(cnode != end_id):
    neigh = getNeighbors(cnode, xedges)
    next_id = getTowardsTarget(neigh, end, nodes)
    path.append(next_id)
    cnode = next_id

print(path)

# Simplify path may be called multiple times
# Until it cannot be simplified further
def simplifyPath(path, start = None, target = None, nodes = [], nedges = []):
    if(len(path) < 3): return path
    if not start in nodes:
        nodes.append(start)
        path[0] = len(nodes) - 1
    if not target in nodes: 
        nodes.append(target)
        path.append(len(nodes) - 1)
    print(path)
    # Check if we can just go straight
    st = nodes[path[0]]
    fl = Line(st, target)
    fitx_count = 0
    for n in nedges:
        itx = Intersection.LineLine(fl, n, tolerance = 1, finiteSegments=True)
        if itx[0] == False: continue
        if itx[1] == 0.0 or itx[1] == 1.0 : continue
        #print(itx)
        fitx_count += 1
        pass
    if(fitx_count == 0): return [path[0], path[len(path) -1]]
    shortcut = []
    skip_next = False
    for i, p in enumerate(path):
        if i > len(path) -3:
            if len(nodes) -1 in shortcut: continue
            shortcut.append(len(nodes) - 1)
            break
        if skip_next: 
            skip_next = False
            continue 
        candidates = [path[i], path[i+1], path[i+2]]
        #print(candidates)
        l = Line(nodes[path[i]], nodes[path[i+2]])
        # Need to check if this line is
        # part of a triangle or inside a triangle
        chkpt = l.PointAt(0.5)
        num_tri_inside = 0
        for t in triangles:
            if not (ptInsideTriangle([chkpt.X, chkpt.Y], t)): continue
            num_tri_inside += 1
        #print(num_tri_inside)
        itx_count = 0
        for n in nedges:
            itx = Intersection.LineLine(l, n, tolerance = 1, finiteSegments=True)
            if itx[0] == False: continue
            if itx[1] == 0.0 or itx[1] == 1.0 : continue
            itx_count += 1
        if i == 0: shortcut.append(path[i])
        if num_tri_inside == 0: 
            skip_next = False
            shortcut.append(path[i+1])
            continue
        #print(itx_count)
        if itx_count == 0:
            shortcut.append(path[i+2])
            skip_next = True
        else:
            shortcut.append(path[i+1])
            skip_next = False
        pass
    return shortcut

def reSimplifyPath(path, start, end, nodes, nedges):
    prev_count = None
    curr_count = len(path)
    shortcut = path
    while(curr_count != prev_count):
        curr_count = len(shortcut)
        shortcut = simplifyPath(shortcut, start, end, nodes, nedges)
        shortcut = simplifyPath(shortcut, start, end, nodes, nedges)
        print(shortcut)
        prev_count = len(shortcut)
    return shortcut

# Find shortcuts
#print(len(nodes))
shortcut = reSimplifyPath(path, start, end, nodes, nedges)

print("next")
#print(shortcut)
c = [nodes[i] for i in shortcut]
a = n1
b = [nodes[i] for i in path]
# ---------- end ghpython_script ----------
data_4 = Data(ghpython_script.c)
polyline = PolyLine(Vertices=data_4, Closed=False)
cull_duplicates = CullDuplicates(Points=ghpython_script.b, Tolerance=0.1, CullMode=3)  # -> Points, Indices, Valence
length = Length(Curve=polyline)
polyline_2 = PolyLine(Vertices=cull_duplicates.Points, Closed=False)
