# Dynamo graph navmesh.dyn (Dynamo 2.19.3.6394)
# packages: MeshToolkit 4.0.0, GenerativeDesign 6.1.1.0

python_script = Python()  # CPython3; unwired: IN[0]
# ---------- python_script.python (15 lines) ----------
# Load the Python Standard and DesignScript Libraries
import sys
import clr
import time
from uuid import uuid4
clr.AddReference('ProtoGeometry')
from Autodesk.DesignScript.Geometry import *

# The inputs to this node will be stored as a list in the IN variables.
dataEnteringNode = IN

# Place your code below this line
directory = "C:/temp/"
# Assign your output to the OUT variable.
OUT = directory + str(int(time.time())) + "_" + str(uuid4()) + ".obj"
# ----------------------------------------

# group: Set to Open to export as obj to C:/temp/fire-synth
gate = Data.Gate(false, python_script)

# note: fire dataset exporter
# Author: Bob Lee
# Dependencies:
# •  MeshToolkit
categories = Categories("OST_Rooms")
all_elements_of_category = ElementsOfCategory(Category=categories)
finishBoundary = Room.FinishBoundary(room=all_elements_of_category)
code_block = CodeBlock(a=finishBoundary) { y = a[0][0]; }
byJoinedCurves = PolyCurve.ByJoinedCurves(curves=code_block)
patch = Curve.Patch(curve=byJoinedCurves)
python_script_2 = Python(IN[0]=finishBoundary)  # CPython3
# ---------- python_script_2.python (20 lines) ----------
# Load the Python Standard and DesignScript Libraries
import sys
import clr
clr.AddReference('ProtoGeometry')
from Autodesk.DesignScript.Geometry import *

# The inputs to this node will be stored as a list in the IN variables.
bounds = IN[0]

obs = []

for i, b in enumerate(bounds[0]):
    if i == 0: continue
    obs.append(b)
    pass

# Place your code below this line

# Assign your output to the OUT variable.
OUT = obs
# ----------------------------------------
byJoinedCurves_2 = PolyCurve.ByJoinedCurves(curves=python_script_2)
byPatch = Surface.ByPatch(closedCurve=byJoinedCurves_2)
code_block_2 = CodeBlock(rm=patch, obsp=byPatch)
# ---------- code_block_2.designscript (13 lines) ----------
rm;
obsp;
b = (obsp == null);
[Imperative]
{
	d = [];
	if(b == false){
	    d = Autodesk.Surface.Difference(rm,obsp);
	}else{
		d = rm;
	};
	return d;
};
# ----------------------------------------
watch = Watch(code_block_2.out3)
code_block_3 = CodeBlock { 1; }
byGeometry = Autodesk.Dynamo.MeshToolkit.Mesh.ByGeometry(inputGeometry=watch, tolerance=code_block_3)
exportMeshes = Autodesk.Dynamo.MeshToolkit.Mesh.ExportMeshes(filename=gate, meshes=byGeometry)
vertices = Autodesk.Dynamo.MeshToolkit.Mesh.Vertices(mesh=byGeometry)
vertexIndicesByTri = Autodesk.Dynamo.MeshToolkit.Mesh.VertexIndicesByTri(mesh=byGeometry)

# group: Set to True to export data to C:/temp/fire-synth
# Do it!
boolean = BoolSelector(false)

boolean_2 = BoolSelector(false)
python_script_3 = Python(IN[0]=finishBoundary, IN[1]=boolean_2)  # CPython3
# ---------- python_script_3.python (46 lines) ----------
# Load the Python Standard and DesignScript Libraries
import sys
import clr
clr.AddReference('ProtoGeometry')
from Autodesk.DesignScript.Geometry import *
from uuid import uuid4
import os
import time
import json
# The inputs to this node will be stored as a list in the IN variables.
bounds = IN[0][0]
write = IN[1]
payload = {
"room": [],
"obstacles": []
}

for i, b in enumerate(bounds):
    if i == 0:
        for p in b:
            payload["room"].append([p.StartPoint.X, p.StartPoint.Y, p.StartPoint.Z])
        continue
    obs = []
    for p in b:
        obs.append([p.StartPoint.X, p.StartPoint.Y, p.StartPoint.Z])
    payload["obstacles"].append(obs)
       
       
    pass
"""
folderpath = "C:/temp/fire-synth"
os.makedirs(folderpath, exist_ok = True)
filename = str(int(time.time())) + "_" + str(uuid4()) + ".json"
filepath = os.path.join(folderpath, filename)

if write:
    with open(filepath, 'w') as f:
        f.write(json.dumps(payload))
"""
OUT = payload




# Place your code below this line
# Assign your output to the OUT variable.
# ----------------------------------------
python_script_4 = Python(IN[0]=vertices, IN[1]=vertexIndicesByTri, IN[2]=boolean, IN[3]=python_script_3)  # CPython3
# ---------- python_script_4.python (42 lines) ----------
# Load the Python Standard and DesignScript Libraries
import sys
import clr
import os
import time
import json
from uuid import uuid4
clr.AddReference('ProtoGeometry')
from Autodesk.DesignScript.Geometry import *

# The inputs to this node will be stored as a list in the IN variables.
vertices = IN[0]
faces = IN[1]
write = IN[2]
surface = IN[3]
o_faces = []
o_verts = []
i = 0
while(i < len(faces)-2):
    o_faces.append([faces[i],  faces[i+1], faces[i+2]])
    i += 3
    pass 

for v in vertices:
    o_verts.append([v.X, v.Y])
    pass

payload = {"navmesh":{"faces":o_faces, "vertices":  o_verts}
,"surface": surface}

folderpath = "C:/temp/fire-synth"
os.makedirs(folderpath, exist_ok = True)
filename = str(int(time.time())) + "_" + str(uuid4()) + ".json"
filepath = os.path.join(folderpath, filename)

if write:
    with open(filepath, 'w') as f:
        f.write(json.dumps(payload))
OUT = payload

# Assign your output to the OUT variable.
#OUT = o_faces
# ----------------------------------------
firstItem = List.FirstItem(list=all_elements_of_category)
